# Grasshopper definition betül assignment 1 final.gh (Grasshopper 1.0.8)

stair_width = Slider(1.1, range=0.5..2)
step_thickness = Slider(0.11, range=0.05..0.25)
radius = Slider(2.8, range=1..5)
steps_per_turn = Slider(18.03, range=12..40)
step_height = Slider(0.15, range=0.1..0.2)
door_interval = Slider(14, range=12..20)
height = Slider(20, range=2..100)
door_height = Slider(2.48, range=1.8..5)

# ---- group: Auto-reloads cdf module on VScode changes
# Setting path for Src AutoReloader: 1. Right click on Path
# 2. Choose "Select a directory"
# 3. Locate the ..\cdf1_teaching\src folder in your computer
path = FilePath("/Users/betulcalisan/Desktop/GitHub/src/")
autoreloader = Python3Script(src_path=path)  # -> out; inputs src_path: String
# ---------- autoreloader: Python ----------
#! python3
import sys, os, time
import scriptcontext as sc
import Rhino, System
from System.IO import FileSystemWatcher, NotifyFilters

VERSION = 1  
pkg = "cdf"

if not src_path:
    raise Exception("Connect a folder to src_path.")
path = os.path.normpath(src_path)
watch_dir = os.path.join(path, pkg)
if not os.path.isdir(watch_dir):
    raise Exception("No '{}' folder found in:\n{}".format(pkg, path))

def unload():
    for name in list(sys.modules):
        if name == pkg or name.startswith(pkg + "."):
            del sys.modules[name]

# Put this folder first in Python's search list
if path in sys.path:
    sys.path.remove(path)
sys.path.insert(0, path)

key = "cdf_watcher_" + str(ghenv.Component.InstanceGuid)
time_key = key + "_time"
version_key = key + "_version"

def stamp():
    sc.sticky[time_key] = time.strftime("%Y-%m-%d %H:%M:%S")

# Replace the old watcher if the folder changed or the script was updated
old = sc.sticky.get(key)
if old is not None and (os.path.normpath(old.Path) != watch_dir
                        or sc.sticky.get(version_key) != VERSION):
    old.Dispose()
    del sc.sticky[key]
    unload()

if key not in sc.sticky:
    comp = ghenv.Component
    last = [0.0]

    def reload_and_rerun():
        unload()
        stamp()
        doc = comp.OnPingDocument()
        if doc is None:            # reloader was deleted or the file closed
            return
        for obj in doc.Objects:
            if "Python" in obj.GetType().Name:
                obj.ExpireSolution(False)   # mark as out of date
        doc.NewSolution(False)              # recompute once

    def on_change(sender, e):
        if not e.FullPath.endswith(".py") or "__pycache__" in e.FullPath:
            return
        if time.time() - last[0] < 0.5:     # ignore the second event of a double save
            return
        last[0] = time.time()
        Rhino.RhinoApp.InvokeOnUiThread(System.Action(reload_and_rerun))

    w = FileSystemWatcher(watch_dir, "*.py")
    w.IncludeSubdirectories = True
    w.NotifyFilter = NotifyFilters.LastWrite
    w.Changed += on_change
    w.EnableRaisingEvents = True
    sc.sticky[key] = w
    sc.sticky[version_key] = VERSION
    stamp()                                  # time the watcher started

msg = "Last reloaded: {}\nWatching: {}".format(sc.sticky.get(time_key, "unknown"), watch_dir)
print(msg)
out = msg
# ---------- end autoreloader ----------
panel = Panel(autoreloader)

# ----
py3 = Python3Script(
    height=height,
    radius=radius,
    stair_width=stair_width,
    step_height=step_height,
    steps_per_turn=steps_per_turn,
    step_thickness=step_thickness,
    door_width=stair_width,
    door_height=door_height,
    door_interval=door_interval)  # -> stairs, blue_surfaces, yellow_surfaces; inputs height: Double, radius: Double, stair_width: Double, step_height: Double, steps_per_turn: Int32, step_thickness: Double, door_width: Double, door_height: Double, door_interval: Int32
# ---------- py3: Python ----------
from cdf import create_cylinder
from cdf import create_spiral_staircase
from cdf import create_door_openings
from cdf import subtract_door_openings
from cdf import separate_door_surfaces


cylinder = create_cylinder(height=height,radius=radius)
stairs = create_spiral_staircase(height=height,radius=radius,stair_width=stair_width, step_height=step_height, steps_per_turn=steps_per_turn, step_thickness=step_thickness)


door_cutters = create_door_openings(
    height=height,
    radius=radius,
    step_height=step_height,
    steps_per_turn=steps_per_turn,
    step_thickness=step_thickness,
    door_width=door_width,
    door_height=door_height,
    door_interval=door_interval,
    clearance=0.10
)

# Boolean difference
cylinder = subtract_door_openings(
    cylinder,
    door_cutters )

    # Separate surfaces for different materials
blue_surfaces, yellow_surfaces = separate_door_surfaces(
    cylinder
)
# ---------- end py3 ----------
preview = CustomPreview(Geometry=py3.stairs, Material=ColourSwatch(SwatchColor=RGB(237, 0, 0)))
preview_2 = CustomPreview(Geometry=py3.yellow_surfaces, Material=ColourSwatch(SwatchColor=RGB(255, 255, 0)))
preview_3 = CustomPreview(Geometry=py3.blue_surfaces, Material=ColourSwatch(SwatchColor=RGB(0, 0, 237)))
